# Grasshopper definition 01_Parametric_Box.gh (Grasshopper 1.0.7)

xy = XYPlane(Origin=Point(0, 0, 0))
rectangle = Rectangle(Plane=xy, XSize=Slider(2000, range=0..2000), YSize=Slider(2000, range=0..2000), Radius=0)  # -> Rectangle, Length
boxrec = BoxRectangle(Rectangle=rectangle.Rectangle, Height=Slider(2000, range=0..2000))
brep = Brep(boxrec)
